# Dynamo graph Home.dyn (Dynamo 1.2.2.91)

number_slider = DoubleSlider(10000, range=2000..10000 step 1000)
code_block = CodeBlock { 1000; }
code_block_2 = CodeBlock(H=number_slider, h=code_block) { 0..H..h; }
byCoordinates = Point.ByCoordinates(z=code_block_2)
code_block_3 = CodeBlock { 1200; 4500; }
byOriginRadii = Ellipse.ByOriginRadii(byCoordinates, code_block_3.out0, code_block_3.out1)
watch_3d = Watch3D(byOriginRadii)
watch = Watch(byOriginRadii)
byOriginNormal = Plane.ByOriginNormal(origin=byCoordinates)
number_slider_2 = DoubleSlider(20, range=0..100 step 10)
code_block_4 = CodeBlock(H=number_slider, h=code_block, a=number_slider_2) { z=H/h; x=a/z; 0..45..x; }
rotate = Geometry.Rotate(byOriginRadii, byOriginNormal, code_block_4.out2)
code_block_5 = CodeBlock { -500; }
offset = Curve.Offset(curve=rotate, distance=code_block_5)
code_block_6 = CodeBlock { 0..1..0.125; }
pointAtParameter = Curve.PointAtParameter(curve=offset, param=code_block_6, lacing=CrossProduct)
transpose = List.Transpose(pointAtParameter)
code_block_7 = CodeBlock { 150; }
byCenterPointRadius = Circle.ByCenterPointRadius(centerPoint=transpose, radius=code_block_7)
byLoft = Surface.ByLoft(byCenterPointRadius)
byGeometry = ImportInstance.ByGeometry(byLoft)
watch_3d_2 = Watch3D(byLoft)
flatten = Flatten(offset)
code_block_8 = CodeBlock { 0..1..0.05; }
pointAtParameter_2 = Curve.PointAtParameter(curve=flatten, param=code_block_8, lacing=CrossProduct)
byPoints = Polygon.ByPoints(pointAtParameter_2)
watch_2 = Watch(pointAtParameter_2)
byElevation = Level.ByElevation(code_block_2)
wall_types = WallTypes("Curtain Wall")
byCurveAndHeight = Wall.ByCurveAndHeight(height=code_block, level=byElevation, wallType=wall_types)  # unwired: curve
transpose_2 = List.Transpose(flatten)
flatten_2 = Flatten(rotate)
code_block_9 = CodeBlock { 0..1..0.0125; }
pointAtParameter_3 = Curve.PointAtParameter(curve=flatten_2, param=code_block_9, lacing=CrossProduct)
byPoints_2 = Polygon.ByPoints(pointAtParameter_3)
floor_types = FloorTypes("Generic Floor - 400mm")
byOutlineTypeAndLevel = Floor.ByOutlineTypeAndLevel(outlineCurves=byPoints_2@L1, floorType=floor_types, level=byElevation)
watch_3d_3 = Watch3D(byOutlineTypeAndLevel)
